# Grasshopper definition 220527_GHTest (1).gh (Grasshopper 1.0.7)
# plug-ins: Bifocals, Karamba3D, Pufferfish, Human, Hops

license = LicenseKaramba3D()
panel = Panel(license)

# ----
# Generate Unseen datasets
# Modify only the index here.
# Leave all other sliders as they are
number_slider = Slider(1022, range=0..2999)
number_slider_2 = Slider(1059, range=0..2999)
number_slider_3 = Slider(1653, range=0..2999)

# ----
# Alter seed values for variation
number_slider_4 = Slider(75, range=0..100)
dom = ConstructDomain(DomainStart=Slider(40, range=40..60), DomainEnd=Slider(150, range=40..150))
dom_2 = ConstructDomain(DomainStart=Slider(1, range=1..2), DomainEnd=Slider(5, range=0..5))
dom_3 = ConstructDomain(DomainStart=Slider(6, range=6..22), DomainEnd=Slider(12, range=6..28))
random = Random(Range=dom, Number=expr("x+1", number_slider_3), Seed=number_slider_4)  # -> graft(Random)
random_2 = Random(Range=dom_3, Number=expr("x+1", number_slider_3), Seed=Slider(46, range=0..100))
random_3 = Random(Range=dom_3, Number=expr("x+1", number_slider_3), Seed=number_slider_4)
random_4 = Random(Range=dom_2, Number=expr("x+1", number_slider_3), Seed=number_slider_4)  # -> graft(Random)
int = Integer(graft(random_2))
int_2 = Integer(graft(random_3))
int_3 = Integer(graft(random))
roundd = RoundToDecimalPlace(NumberX=random_4, DecimalPlace="2", RoundType=0)  # -> Rounded, Difference
multiplication = Multiplication(A=int, B="2")
multiplication_2 = Multiplication(A=int_2, B="2")
merge = Merge(Data1=simplify(multiplication_2), Data2=simplify(multiplication), Data3=simplify(roundd.Rounded), Data4=simplify(int_3))
branch = TreeBranch(Tree=simplify(merge), Path=number_slider_3, MaintainPaths=True)
item = ListItem(List=branch, Index=0, Wrap=True)  # -> Item, Item1, Item2, Item3

plane_dimensions = Slider(100, range=0..250)
plane_dimensions_2 = Slider(100, range=0..250)
panel_2 = Panel(item.Item1)
cluster = Cluster(
    G=Toggle(True),
    inset_i=item.Item2,
    d1=plane_dimensions_2,
    d2=plane_dimensions,
    d3=item.Item,
    d4=item.Item1,
    A=item.Item3)  # -> mesh_2, valley_3, valley_4, R, R_2, R_3, sector_angle_2, disp, disp_3, disp_2

brec = BoundingRectangle(Geometry=[cluster.valley_3, cluster.valley_4], Plane=PlaneXY(0, 0, 0), Axis=0, Slide=0, Union=True)  # -> Bounding, DimensionX, DimensionY
preview = CustomPreview(Geometry=cluster.valley_3, Material=ColourSwatch(SwatchColor=RGB(255, 0, 0)))
preview_2 = CustomPreview(Geometry=cluster.valley_4, Material=ColourSwatch(SwatchColor=RGB(0, 0, 255)))

bbox = BoundingBox(Content=cluster.mesh_2, Plane=PlaneXY(0, 0, 0))  # -> Box, Box_2
number_slider_5 = Slider(14, range=0..100)
edges = BrepEdges(Brep=bbox.Box)  # -> Naked, Interior, NonManifold

# ----
# Actual Model Reference
debrep = DeconstructBrep(Brep=bbox.Box)  # -> Faces, Edges, Vertices
len = Length(Curve=debrep.Edges)
box = EvaluateBox(Box=bbox.Box, UParameter="0", VParameter="0", WParameter="0")  # -> Plane, Point, Include
intersection = SetIntersection(SetA=len)
item_2 = ListItem(List=intersection, Index=0, Wrap=True)  # -> Item, Item1, Item2

panel_3 = Panel(cluster.disp)
panel_4 = Panel(cluster.disp_3)

medges = MeshEdges(Mesh=cluster.mesh_2)  # -> NakedEdges, InteriorEdges, NonManifoldEdges
# Actual Origami Reference
swatch = ColourSwatch(SwatchColor=RGB(255, 255, 255))
preview_3 = CustomPreview(Geometry=cluster.mesh_2, Material=swatch)
previewlw = CustomPreviewLineweights(
    Geometry=[medges.NakedEdges, medges.InteriorEdges],
    Shader=ColourSwatch(SwatchColor=RGB(151, 154, 184)),
    Thickness=Slider(2.49, range=0..10),
    Absolute=False)
previewlw_2 = CustomPreviewLineweights(
    Geometry=edges.Interior,
    Shader=ColourSwatch(SwatchColor=RGB(151, 154, 184)),
    Thickness=Slider(2.49, range=0..10),
    Absolute=False)

# ----
# Truth Boundary
panel_5 = Panel("100")
division = Division(A=cluster.disp_3, B=panel_5)
division_2 = Division(A=cluster.disp, B=panel_5)
subtraction = Subtraction(A=item_2.Item, B=division_2)
subtraction_2 = Subtraction(A=item_2.Item1, B=division)
box_2 = DomainBox(Base=box.Plane, X=subtraction, Y=subtraction_2, Z=item_2.Item2)
edges_2 = BrepEdges(Brep=box_2)  # -> Naked, Interior, NonManifold
previewlw_3 = CustomPreviewLineweights(
    Geometry=edges_2.Interior,
    Shader=ColourSwatch(SwatchColor=RGB(21, 92, 158)),
    Thickness=Slider(6, range=0..10),
    Absolute=False)

# ----
# Original datasets
# Modify only the index here.
# Leave all other sliders as they are
number_slider_6 = Slider(88, range=0..2999)

number_slider_7 = Slider(4, range=0..100)
dom_4 = ConstructDomain(DomainStart=Slider(40, range=0..40), DomainEnd=Slider(150, range=10..170))
dom_5 = ConstructDomain(DomainStart=Slider(1, range=0..100), DomainEnd=Slider(5, range=0..15))
dom_6 = ConstructDomain(DomainStart=Slider(4, range=0..100), DomainEnd=Slider(12, range=0..50))
random_5 = Random(Range=dom_4, Number=expr("x+1", number_slider_6), Seed=number_slider_7)  # -> graft(Random)
random_6 = Random(Range=dom_6, Number=expr("x+1", number_slider_6), Seed=Slider(6, range=0..100))
random_7 = Random(Range=dom_6, Number=expr("x+1", number_slider_6), Seed=number_slider_7)
random_8 = Random(Range=dom_5, Number=expr("x+1", number_slider_6), Seed=number_slider_7)  # -> graft(Random)
int_4 = Integer(graft(random_6))
int_5 = Integer(graft(random_7))
int_6 = Integer(graft(random_5))
roundd_2 = RoundToDecimalPlace(NumberX=random_8, DecimalPlace="2", RoundType=0)  # -> Rounded, Difference
multiplication_3 = Multiplication(A=int_4, B="2")

multiplication_4 = Multiplication(A=int_5, B="2")

merge_2 = Merge(
    Data1=simplify(multiplication_4),
    Data2=simplify(multiplication_3),
    Data3=simplify(roundd_2.Rounded),
    Data4=simplify(int_6))
branch_2 = TreeBranch(Tree=simplify(merge_2), Path=number_slider_6, MaintainPaths=True)
item_3 = ListItem(List=branch_2, Index=0, Wrap=True)  # -> Item, Item1, Item2, Item3

# ----
# model1_degree6
panel_6 = Panel("http://83e2-35-245-210-174.ngrok.io")
concat = Concatenate(FragmentA=panel_6, FragmentB="/gHml_model1")
panel_7 = Panel(concat)
hops = Hops(
    _Path=panel_7,
    U_subdivision=item_3.Item,
    V_subdivisions=item_3.Item1,
    Dihedral_folding_Angle=item_3.Item3,
    Inset=item_3.Item2,
    Folded_length=cluster.R,
    Folded_breadth=cluster.R_2,
    CacheResultsInMemory=False,
    CacheSolveResults=False,
    RemoteDefinitionLocation="http://83e2-35-245-210-174.ngrok.io/gHml_model1",
    RemoteSolveVersion=(0, 1, 0),
    ShowInput_Enabled=False,
    ShowInput_Path=True,
    SynchronousSolve=True)  # -> X, Y

# ----
# model2_degree10
panel_8 = Panel("http://bd88-35-245-210-174.ngrok.io")
concat_2 = Concatenate(FragmentA=panel_8, FragmentB="/gHml_model2")
panel_9 = Panel(concat_2)
hops_2 = Hops(
    _Path=panel_9,
    U_subdivision=item_3.Item,
    V_subdivisions=item_3.Item1,
    Dihedral_folding_Angle=item_3.Item3,
    Inset=item_3.Item2,
    Folded_length=cluster.R,
    Folded_breadth=cluster.R_2,
    CacheResultsInMemory=True,
    CacheSolveResults=True,
    RemoteDefinitionLocation="http://bd88-35-245-210-174.ngrok.io/gHml_model2",
    RemoteSolveVersion=(0, 1, 0),
    ShowInput_Enabled=False,
    ShowInput_Path=True,
    SynchronousSolve=True)  # -> X, Y

panel_10 = Panel(hops_2.X)
panel_11 = Panel(hops_2.Y)
panel_12 = Panel(hops.Y)
panel_13 = Panel(hops.X)

# ----
# swap out the A in both (x for top component, y for lower component) to switch between degrees 6 and 10 models
# Prediction Boundary
panel_14 = Panel("100")
division_3 = Division(A=hops.Y, B=panel_14)
division_4 = Division(A=hops.X, B=panel_14)
subtraction_3 = Subtraction(A=item_2.Item1, B=division_3)
subtraction_4 = Subtraction(A=item_2.Item, B=division_4)
box_3 = DomainBox(Base=box.Plane, X=subtraction_4, Y=subtraction_3, Z=item_2.Item2)
edges_3 = BrepEdges(Brep=box_3)  # -> Naked, Interior, NonManifold
previewlw_4 = CustomPreviewLineweights(
    Geometry=edges_3.Interior,
    Shader=ColourSwatch(SwatchColor=RGB(158, 27, 158)),
    Thickness=Slider(6.37, range=0..10),
    Absolute=False)

# ==== cluster Cluster
inset_i = ClusterInput()
d4 = ClusterInput()
d1 = ClusterInput()
d2 = ClusterInput()
A = ClusterInput()
d3 = ClusterInput()
G = ClusterInput()
max = Maximum(A=A, B="1")
expression = Expression(x=max, Expression="(180-x)")
panel = Panel("""0
1""")
number_slider = Slider(20, range=0..100)
series = Series(Start=Slider(0, range=0..100), Step=1, Count=expr("(x*2)+2", d4))
sector_angle = Panel("""length(L)
breadth(B)
u_subdivision(u)
v_subdivisions(v)
sector_angle(sA)
dihedral_folding_Angle (dA)
unit_length(a)
unit_width(b)
inset(i)
folded_length(fL)
folded_breadth (fB)
folded_height(h)
load(N)
Z_displacement(zD)
x_displacement(xD)
y_displacement(yD)""")

division = Division(A=inset_i, B="100")
division_2 = Division(A=d1, B="100")
division_3 = Division(A=d2, B="100")
division_4 = Division(A=division_2, B="2")
min = Minimum(A=division_4, B=division)

subtraction = Subtraction(A=division_2, B=min)

planesrf = PlaneSurface(Plane=PlaneXY(0, 0, 0), XSize=subtraction, YSize=division_3)

filter = StreamFilter(Gate=G, Stream1=planesrf)
sdivide = DivideSurface(Surface=filter, UCount=d3, VCount=d4)  # -> Points, Normals, Parameters
dispatch = Dispatch(List=sdivide.Points, DispatchPattern=panel)  # -> ListA, ListB
X = UnitX(Factor=min)
data = Data(dispatch.ListA)
data_2 = Data(dispatch.ListB)
move = Move(Geometry=data, Motion=X)  # -> Geometry, Transform
weave = Weave(Pattern=[0, 1], Stream0=data_2, Stream1=move.Geometry, NullGaps=False)

# ---- group: Visualising Mountains and Valleys
cull_i = CullIndex(List=data_2, Indices=0, Wrap=True)
flip = FlipMatrix(Data=data_2)
ln = Line(StartPoint=move.Geometry, EndPoint=cull_i)  # -> simplify(Line)
flip_2 = FlipMatrix(Data=move.Geometry)
ln_2 = Line(StartPoint=move.Geometry, EndPoint=data_2)
flip_3 = FlipMatrix(Data=ln)
flip_4 = FlipMatrix(Data=ln_2)
pline = PolyLine(Vertices=flip, Closed=False)
pline_2 = PolyLine(Vertices=flip_2, Closed=False)
dispatch_2 = Dispatch(List=flip_3, DispatchPattern=[True, False])  # -> ListA, ListB
dispatch_3 = Dispatch(List=simplify(flip_4), DispatchPattern=[True, False])  # -> ListA, ListB
explode = Explode(Curve=pline_2, Recursive=True)  # -> Segments, Vertices
explode_2 = Explode(Curve=pline, Recursive=True)  # -> Segments, Vertices
dispatch_4 = Dispatch(List=explode.Segments, DispatchPattern=[True, False])  # -> ListA, ListB
dispatch_5 = Dispatch(List=explode_2.Segments, DispatchPattern=[False, True])  # -> ListA, ListB
line = Line([dispatch_4.ListA, dispatch_5.ListA])
crv = Curve(simplify([dispatch_3.ListB, dispatch_2.ListB]))
line_2 = Line([dispatch_4.ListB, dispatch_5.ListB])
crv_2 = Curve([dispatch_2.ListA, dispatch_3.ListA])

# ----
frompoints = MeshFromPoints(Points=flatten(weave), UDirection=expr("x+1", d3), VDirection=expr("x+1", d4))
wbjoin = WeaverbirdsJoinMeshesAndWeld(Mesh=frompoints, Weld=False)
weave_2 = Weave(Pattern=[0, 1], Stream0=move.Geometry, Stream1=data_2, NullGaps=False)  # -> simplify(Weave)
flip_5 = FlipMatrix(Data=sdivide.Points)
split = SplitTree(Data=weave_2, Masks=flatten("{0,2,...}"))  # -> Positive, Negative
branch = TreeBranch(Tree=simplify(flip_5), Path="{0}", MaintainPaths=True)
demesh = DeconstructMesh(Mesh=wbjoin)  # -> Vertices, Faces, Colours, Normals
pt = Point(split.Positive)
pt_2 = Point(branch)

# ---- group: Visualising Mountains and Valleys / valley-mountain curves
valley = Curve(flatten([line_2, crv]))
valley_2 = Curve(flatten([crv_2, line]))

# ----
cp = ClosestPoint(Point=flatten(demesh.Vertices), Cloud=flatten(pt))  # -> ClosestPoint, CPIndex, flatten(Distance)
cp_2 = ClosestPoint(Point=flatten(demesh.Vertices), Cloud=flatten(pt_2))  # -> ClosestPoint, CPIndex, flatten(Distance)
smaller = SmallerThan(FirstNumber=flatten(cp.Distance), SecondNumber="0.0001")  # -> SmallerThan, OrEqualTo
smaller_2 = SmallerThan(FirstNumber=flatten(cp_2.Distance), SecondNumber="0.0001")  # -> SmallerThan, OrEqualTo
cull = CullPattern(List=demesh.Vertices, CullPattern=smaller.OrEqualTo)
cull_2 = CullPattern(List=demesh.Vertices, CullPattern=smaller_2.SmallerThan)

hingepoints = HingePoints(Mesh=wbjoin)  # -> _1, _2, _3, _4
nofoldthrough = NoFoldThrough(FoldStart=hingepoints._1, FoldEnd=hingepoints._2, Tip1=hingepoints._3, Tip2=hingepoints._4, Strength=1)

wbfacepolys = WeaverbirdsFacePolylines(Mesh=wbjoin)
disc = Discontinuity(Curve=wbfacepolys, Level=1)  # -> simplify(Points), Parameters
item = ListItem(List=disc.Points, Index=0, Wrap=True)  # -> Item, Item1, Item2, Item3
ln_3 = Line(StartPoint=item.Item, EndPoint=item.Item2)
ln_4 = Line(StartPoint=item.Item1, EndPoint=item.Item3)
merge = Merge(Data1=ln_3, Data2=ln_4)
length_line = LengthLine(Line=merge, Strength=Slider(100, range=0..100))

neg = Negative(Value=expression)
rad = Radians(Degrees=neg)
ln_5 = Line(StartPoint=hingepoints._1, EndPoint=hingepoints._2)
hinge = Hinge(FoldStart=hingepoints._1, FoldEnd=hingepoints._2, Tip1=hingepoints._3, Tip2=hingepoints._4, RestAngle=rad, Strength=1)
curvepoint = PointOnCurve(ln_5, parameter=0.5)
curvepoint_2 = PointOnCurve(valley, parameter=0.5)
pull = PullPoint(Point=curvepoint, Geometry=curvepoint_2, ClosestOnly=True)  # -> ClosestPoint, Distance
smaller_3 = SmallerThan(FirstNumber=pull.Distance, SecondNumber="0.001")  # -> SmallerThan, OrEqualTo
cull_3 = CullPattern(List=hinge, CullPattern=smaller_3.OrEqualTo)

rad_2 = Radians(Degrees=expression)
ln_6 = Line(StartPoint=hingepoints._1, EndPoint=hingepoints._2)
hinge_2 = Hinge(FoldStart=hingepoints._1, FoldEnd=hingepoints._2, Tip1=hingepoints._3, Tip2=hingepoints._4, RestAngle=rad_2, Strength=1)
curvepoint_3 = PointOnCurve(valley_2, parameter=0.5)
curvepoint_4 = PointOnCurve(ln_6, parameter=0.5)
pull_2 = PullPoint(Point=curvepoint_4, Geometry=curvepoint_3, ClosestOnly=True)  # -> ClosestPoint, Distance
smaller_4 = SmallerThan(FirstNumber=pull_2.Distance, SecondNumber="0.0001")  # -> SmallerThan, OrEqualTo
cull_4 = CullPattern(List=hinge_2, CullPattern=smaller_4.SmallerThan)

toggle = BooleanToggle(True)
toggle_2 = BooleanToggle(False)
anchorxyz = AnchorXYZ(Point=cull_2, X=toggle_2, Y=toggle, Z=toggle_2, Strength=1000)
anchorxyz_2 = AnchorXYZ(Point=cull, X=toggle_2, Y=toggle_2, Z=toggle, Strength=1000)

edgelengths = EdgeLengths(Mesh=wbjoin, LengthFactor=1, Strength=Slider(100, range=0..100))

show = Show(G=wbjoin)
merge_2 = Merge(
    Data1=anchorxyz_2,
    Data2=anchorxyz,
    Data3=length_line,
    Data4=edgelengths,
    Data5=nofoldthrough,
    Data6=cull_4,
    Data7=cull_3)

entwine = Entwine(Branch00=show, Branch01=merge_2, FlattenInputs=True)
panel_2 = Panel("0.00000005")
zombiesolver = ZombieSolver(GoalObjects=entwine, Threshold="0.00000001", Tolerance=0.0001, MaxIterations=Slider(2000, range=0..10000))  # -> I, V, O
item_2 = ListItem(List=zombiesolver.O, Index=0, Wrap=True)

bbox = BoundingBox(Content=item_2, Plane=PlaneXY(0, 0, 0))  # -> Box, Box_2
debrep = DeconstructBrep(Brep=bbox.Box)  # -> Faces, Edges, Vertices
mesh = Mesh(item_2)
rh_out_mesh = Mesh(mesh)

# ---- group: Output Points
demesh_2 = DeconstructMesh(Mesh=rh_out_mesh)  # -> Vertices, Faces, Colours, Normals
pt_3 = Point(demesh_2.Vertices)

# ----
medges = MeshEdges(Mesh=rh_out_mesh)  # -> NakedEdges, InteriorEdges, NonManifoldEdges
readmattable = ReadMaterialTableFromFileKaramba3D()
crv_3 = Curve(medges.InteriorEdges)
line_joint = LineJointKaramba3D(
    JointCurve=crv_3,
    AtElementIdentifier="shell",
    YOrientation="0,1,0",
    ZOrientation=Vector(0, 0, 1),
    DAlpha_deg=Slider(150, range=0..180),
    Ct_kN_m_m=Vector(0, 0, 0),
    Cr_kNm_m_rad="20,0,0",
    menu=[buttons(off, off, off, on, off, off)])
cross_section = CrossSectionKaramba3D(
    FamilyNameOfCrossSection="DefaultCroSec",
    ElementIdentifier="shell",
    Material=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,
    Height_cm=".3",
    mode="Shell - Const")
matselect = MaterialSelectionKaramba3D(Materials=readmattable, NameOrListIndexOfMaterial="214", ElementIdentifier="shell", menu=[dropdown(1), dropdown(1)])

preview = CustomPreview(
    Geometry=rh_out_mesh,
    Material={diffuse=RGB(221, 160, 221), emission=RGB(66, 48, 66), shine=0.5, specular=RGB(255, 255, 255), transparency=0})
pdecon = Deconstruct(Point=pt_3)  # -> XComponent, YComponent, ZComponent
smaller_5 = SmallerThan(FirstNumber=pdecon.ZComponent, SecondNumber="0.0001")  # -> SmallerThan, OrEqualTo
dispatch_6 = Dispatch(List=pt_3, DispatchPattern=smaller_5.SmallerThan)  # -> ListA, ListB
pt_4 = Point(dispatch_6.ListA)
pt_5 = Point(dispatch_6.ListB)
pull_3 = PullPoint(Point=pt_4, Geometry=pt_3, ClosestOnly=True)  # -> ClosestPoint, Distance
pull_4 = PullPoint(Point=pt_5, Geometry=pt_3, ClosestOnly=True)  # -> ClosestPoint, Distance
lng = ListLength(List=pull_4.ClosestPoint)
division_5 = Division(A="100", B=lng)
Z = UnitZ(Factor=division_5)  # -> expr("-x", UnitVector)
supp = SupportKaramba3D(PosInd=pull_3.ClosestPoint, menu=[buttons(on, on, on, off, off, off)])
loads = LoadsKaramba3D(ForceVector=Z, Local=False, PosInd=pull_4.ClosestPoint, LCase="0", mode="Point")
meshtoshell = MeshToShellKaramba3D(Mesh=rh_out_mesh, Identifier="shell", LimitDistance_m=0.005, Bending=Toggle(True))  # -> Element, Points, Info
merge_3 = Merge(Data1=loads)
assemble = AssembleModelKaramba3D(
    Point=flatten(meshtoshell.Points),
    Elem=flatten(meshtoshell.Element),
    Support=flatten(supp),
    Load=flatten(merge_3),
    CrossSection=flatten(cross_section),
    Material=flatten(matselect),
    Joint=flatten(line_joint),
    LimitDistance_m=0.005)  # -> Model, Info, Mass_kg, CenterOfGravity, LoadCaseNames
analyze = AnalyzeKaramba3D(Model=assemble.Model)  # -> CalculatedModel, MaximumDisplacement_cm, ResultingForceOfGravity_kN, ElasticEnergy_kNm
panel_3 = Panel(analyze.MaximumDisplacement_cm)
modelview = ModelViewKaramba3D(Model=analyze.CalculatedModel, ResultFactors=1, ResultCase=-1)  # -> Model, DeformedMesh, DeformedAxes, DeformedModel; disabled
relay = Relay()  # disabled
shellview = ShellViewKaramba3D(Model=modelview.Model, IndexOfLayer=0)  # -> Model, MeshesOfRenderedShells, LegendColors, LegendTags; disabled
legend = Legend(Colour=shellview.LegendColors, Tags=shellview.LegendTags, LegendType=1)  # disabled

partition = PartitionList(List=flatten(pt_3), Size=expr("x+1", d4))
flip_6 = FlipMatrix(Data=partition)
pline_3 = PolyLine(Vertices=partition, Closed=False)
item_3 = ListItem(List=flatten(pline_3), Index=0, Wrap=True)  # -> Item2, Item1, Item, Item1_2
item_4 = ListItem(List=flatten(pline_3), Index=0, Wrap=True)  # -> Item, Item1
panel_4 = Panel("""0
-1""")
disc_2 = Discontinuity(Curve=[item_3.Item2, item_3.Item1], Level=1)  # -> Points, Parameters
disc_3 = Discontinuity(Curve=[item_4.Item1, item_4.Item], Level=1)  # -> Points, Parameters
cull_i_2 = CullIndex(List=disc_2.Points, Indices=panel_4, Wrap=True)  # -> flatten(List)
cull_i_3 = CullIndex(List=disc_3.Points, Indices=panel_4, Wrap=True)  # -> flatten(List)
pull_5 = PullPoint(Point=cull_i_2, Geometry=pt_3, ClosestOnly=True)  # -> ClosestPoint, Distance
pull_6 = PullPoint(Point=cull_i_3, Geometry=pt_3, ClosestOnly=True)  # -> ClosestPoint, Distance
item_5 = ListItem(List=reverse(pt_3), Index=series, Wrap=True)
item_6 = ListItem(List=pt_3, Index=series, Wrap=True)
lng_2 = ListLength(List=pull_5.ClosestPoint)
division_6 = Division(A="100", B=lng_2)
X_2 = UnitX(Factor=division_6)
supp_2 = SupportKaramba3D(PosInd=pull_5.ClosestPoint, menu=[buttons(on, on, on, off, off, off)])
loads_2 = LoadsKaramba3D(ForceVector=X_2, Local=False, PosInd=pull_6.ClosestPoint, LCase="0", mode="Point")
assemble_2 = AssembleModelKaramba3D(
    Point=meshtoshell.Points,
    Elem=flatten(meshtoshell.Element),
    Support=flatten(supp_2),
    Load=flatten(loads_2),
    CrossSection=flatten(cross_section),
    Material=flatten(matselect),
    Joint=flatten(line_joint),
    LimitDistance_m=0.005)  # -> Model, Info, Mass_kg, CenterOfGravity, LoadCaseNames
analyze_2 = AnalyzeKaramba3D(Model=assemble_2.Model)  # -> CalculatedModel, MaximumDisplacement_cm, ResultingForceOfGravity_kN, ElasticEnergy_kNm
modelview_2 = ModelViewKaramba3D(Model=analyze_2.CalculatedModel, ResultFactors=1, ResultCase=-1)  # -> Model, DeformedMesh, DeformedAxes, DeformedModel; disabled
shellview_2 = ShellViewKaramba3D(Model=modelview_2.Model, IndexOfLayer=0)  # -> Model, MeshesOfRenderedShells, LegendColors, LegendTags; disabled
legend_2 = Legend(Colour=shellview_2.LegendColors, Tags=shellview_2.LegendTags, LegendType=1)  # disabled

partition_2 = PartitionList(List=flatten(pt_3), Size=expr("x+1", d4))
flip_7 = FlipMatrix(Data=partition_2)
pline_4 = PolyLine(Vertices=flip_7, Closed=False)
item_7 = ListItem(List=flatten(pline_4), Index=0, Wrap=True)  # -> Item2, Item1, Item, Item1_2
item_8 = ListItem(List=flatten(pline_4), Index=0, Wrap=True)  # -> Item, Item1
panel_5 = Panel("""0
-1""")
disc_4 = Discontinuity(Curve=[item_7.Item2, item_7.Item1], Level=1)  # -> Points, Parameters
disc_5 = Discontinuity(Curve=[item_8.Item1, item_8.Item], Level=1)  # -> Points, Parameters
cull_i_4 = CullIndex(List=disc_4.Points, Indices=panel_5, Wrap=True)  # -> flatten(List)
cull_i_5 = CullIndex(List=disc_5.Points, Indices=panel_5, Wrap=True)  # -> flatten(List)
pull_7 = PullPoint(Point=cull_i_4, Geometry=pt_3, ClosestOnly=True)  # -> ClosestPoint, Distance
pull_8 = PullPoint(Point=cull_i_5, Geometry=pt_3, ClosestOnly=True)  # -> ClosestPoint, Distance
lng_3 = ListLength(List=pull_7.ClosestPoint)
division_7 = Division(A="100", B=lng_3)
Y = UnitY(Factor=expr("-x", division_7))
supp_3 = SupportKaramba3D(PosInd=pull_8.ClosestPoint, menu=[buttons(on, on, on, off, off, off)])
loads_3 = LoadsKaramba3D(ForceVector=Y, Local=False, PosInd=pull_7.ClosestPoint, LCase="0", mode="Point")
assemble_3 = AssembleModelKaramba3D(
    Point=meshtoshell.Points,
    Elem=flatten(meshtoshell.Element),
    Support=flatten(supp_3),
    Load=flatten(loads_3),
    CrossSection=flatten(cross_section),
    Material=flatten(matselect),
    Joint=flatten(line_joint),
    LimitDistance_m=0.005)  # -> Model, Info, Mass_kg, CenterOfGravity, LoadCaseNames
analyze_3 = AnalyzeKaramba3D(Model=assemble_3.Model)  # -> CalculatedModel, MaximumDisplacement_cm, ResultingForceOfGravity_kN, ElasticEnergy_kNm
modelview_3 = ModelViewKaramba3D(Model=analyze_3.CalculatedModel, ResultFactors=1, ResultCase=-1)  # -> Model, DeformedMesh, DeformedAxes, DeformedModel
shellview_3 = ShellViewKaramba3D(Model=modelview_3.Model, IndexOfLayer=0)  # -> Model, MeshesOfRenderedShells, LegendColors, LegendTags
legend_3 = Legend(Colour=shellview_3.LegendColors, Tags=shellview_3.LegendTags, LegendType=1)

angle = Angle(VectorA=flatten(pline), VectorB=flatten(ln_2))  # -> Angle, Reflex
len = Length(Curve=flatten(ln_2))
len_2 = Length(Curve=flatten(explode_2.Segments))
sunion = SetUnion(SetA=flatten(angle.Angle))
deg = Degrees(Radians=sunion)
sunion_2 = SetUnion(SetA=len_2)
sunion_3 = SetUnion(SetA=len)
subtraction_2 = Subtraction(A="180", B=deg)
roundd = RoundToDecimalPlace(NumberX=subtraction_2, DecimalPlace="2", RoundType=0)  # -> Rounded, Difference

len_3 = Length(Curve=debrep.Edges)
sunion_4 = SetUnion(SetA=len_3)  # -> simplify(flatten(Union))
panel_6 = Panel(sunion_3)
panel_7 = Panel(roundd.Rounded)
panel_8 = Panel(sunion_2)
item_9 = ListItem(List=sunion_4, Index=0, Wrap=True)  # -> Item, Item1, Item2
multiplication = Multiplication(A=panel_8, B="100")
multiplication_2 = Multiplication(A=panel_6, B="100")
multiplication_3 = Multiplication(A=item_9.Item1, B="100")
multiplication_4 = Multiplication(A=item_9.Item2, B="100")
multiplication_5 = Multiplication(A=item_9.Item, B="100")
merge_4 = Merge(
    Data1=flatten(d1),
    Data2=flatten(d2),
    Data3=flatten(d3),
    Data4=flatten(d4),
    Data5=flatten(panel_7),
    Data6=flatten(A),
    Data7=flatten(multiplication_2),
    Data8=flatten(multiplication),
    Data10=flatten(multiplication_5),
    Data11=flatten(multiplication_3),
    Data12=flatten(multiplication_4),
    Data13=flatten("100"))
panel_9 = Panel(merge_4)
valley_3 = ClusterOutput(valley_2)
valley_4 = ClusterOutput(valley)
mesh_2 = ClusterOutput(mesh)
R = ClusterOutput(multiplication_5)
R_2 = ClusterOutput(multiplication_3)
R_3 = ClusterOutput(multiplication_4)
sector_angle_2 = ClusterOutput(panel_7)
disp = ClusterOutput(analyze_2.MaximumDisplacement_cm)
disp_2 = ClusterOutput(analyze.MaximumDisplacement_cm)
disp_3 = ClusterOutput(analyze_3.MaximumDisplacement_cm)
